vi "posCluster.gvi"   [LabVIEW NXG 3.1.0]
outputs:
  "created cluster": T1
types:
  T1 = cluster{"Element 1": cluster{"Left": f32, "Top": f32}[], "Element 2": cluster{"Left": f32, "Top": f32}[], "Element 3": cluster{"Left": f32, "Top": f32}[]}
diagram:
  sequence {
    frame 0 {
      Build Array(cluster{"Left": f32, "Top": f32} {"Left"=209, "Top"=215}, cluster{"Left": f32, "Top": f32} {"Left"=649, "Top"=215}, cluster{"Left": f32, "Top": f32} {"Left"=1089, "Top"=215}, cluster{"Left": f32, "Top": f32} {"Left"=1529, "Top"=215}, cluster{"Left": f32, "Top": f32} {"Left"=209, "Top"=647}, cluster{"Left": f32, "Top": f32} {"Left"=649, "Top"=647}, cluster{"Left": f32, "Top": f32} {"Left"=1089, "Top"=647}, cluster{"Left": f32, "Top": f32} {"Left"=1529, "Top"=647}) -> w1
    }
    frame 1 {
      Build Array(cluster{"Left": f32, "Top": f32} {"Left"=178, "Top"=177}, cluster{"Left": f32, "Top": f32} {"Left"=612, "Top"=177}, cluster{"Left": f32, "Top": f32} {"Left"=1052, "Top"=177}, cluster{"Left": f32, "Top": f32} {"Left"=1497, "Top"=177}, cluster{"Left": f32, "Top": f32} {"Left"=178, "Top"=605}, cluster{"Left": f32, "Top": f32} {"Left"=612, "Top"=605}, cluster{"Left": f32, "Top": f32} {"Left"=1052, "Top"=605}, cluster{"Left": f32, "Top": f32} {"Left"=1497, "Top"=605}) -> w2
    }
    frame 2 {
      Build Array(cluster{"Left": f32, "Top": f32} {"Left"=210, "Top"=216}, cluster{"Left": f32, "Top": f32} {"Left"=650, "Top"=216}, cluster{"Left": f32, "Top": f32} {"Left"=1090, "Top"=216}, cluster{"Left": f32, "Top": f32} {"Left"=1530, "Top"=216}, cluster{"Left": f32, "Top": f32} {"Left"=210, "Top"=648}, cluster{"Left": f32, "Top": f32} {"Left"=650, "Top"=648}, cluster{"Left": f32, "Top": f32} {"Left"=1090, "Top"=648}, cluster{"Left": f32, "Top": f32} {"Left"=1530, "Top"=648}, cluster{"Left": f32, "Top": f32} {"Left"=-200, "Top"=0}) -> w3
    }
  }
  Build Cluster(w1, w2, w3) -> w4
  $"created cluster" <- w4
